# Grasshopper definition molo_pn3.gh (Grasshopper 1.0.8)
# plug-ins: RhinoCodePluginGH, Pufferfish

# ---- group: Vymezení
line = Line(Line((-184130, -1214840, 0), (-202020, -1203000, 0)))

# ---- group: Vymezení / korekce Z
vector_z = Vector(Vector(0, 0, 225000))
move = Move(Geometry=line, Motion=vector_z)  # -> Geometry, Transform

# ---- group: Vymezení / Šířka
molo_width = Slider(2846, range=2000..20000)
multiplication = Multiplication(A=molo_width, B=-1)
construct_domain = ConstructDomain(DomainStart=multiplication, DomainEnd=molo_width)

# ---- group: Vymezení / Rovina
control_points = ControlPoints(Curve=move.Geometry)  # -> Points, Weights, Knots
list_item = ListItem(List=control_points.Points, Index=0, Wrap=True)
line_dir = CSharpScript(line=line)  # -> out, a; inputs line: Line
# ---------- line_dir: C# ----------
// Grasshopper Script Instance
#region Usings
using System;
using System.Linq;
using System.Collections;
using System.Collections.Generic;
using System.Drawing;

using Rhino;
using Rhino.Geometry;

using Grasshopper;
using Grasshopper.Kernel;
using Grasshopper.Kernel.Data;
using Grasshopper.Kernel.Types;
#endregion

public class Script_Instance : GH_ScriptInstance
{
    #region Notes
    /* 
      Members:
        RhinoDoc RhinoDocument
        GH_Document GrasshopperDocument
        IGH_Component Component
        int Iteration

      Methods (Virtual & overridable):
        Print(string text)
        Print(string format, params object[] args)
        Reflect(object obj)
        Reflect(object obj, string method_name)
    */
    #endregion

    private void RunScript(Line line, ref object a)
    {
        a = Math.Atan2(line.Direction.Y,line.Direction.X);
    }
}
# ---------- end line_dir ----------
xy_plane = XYPlane(Origin=list_item)
rotate_plane = RotatePlane(Plane=xy_plane, Angle=line_dir.a)

# ---- group: Vymezení / Délka
length = Length(Curve=line)

# ---- group: Vymezení
rectangle = Rectangle(Plane=rotate_plane, XSize=length, YSize=construct_domain, Radius=0)  # -> Rectangle, Length
plane = Plane(rotate_plane)

# ---- group: hlavní tvar / náhodné body / Nastavení tvaru
seed = Slider(8, range=0..100)
number_slider = Slider(7, range=0..30)

# ---- group: hlavní tvar / náhodné body
populate_2d = Populate2D(Region=rectangle.Rectangle, Count=number_slider, Seed=seed)

# ---- group: hlavní tvar / metaballs 2D
list_length = ListLength(List=populate_2d)
multiplication_2 = Multiplication(A=Slider(0.249298, range=0..1), B="1e-6")
list_value_1 = CSharpScript(cnt=list_length)  # -> a; inputs cnt: Int32
# ---------- list_value_1: C# ----------
// Grasshopper Script Instance
#region Usings
using System;
using System.Linq;
using System.Collections;
using System.Collections.Generic;
using System.Drawing;

using Rhino;
using Rhino.Geometry;

using Grasshopper;
using Grasshopper.Kernel;
using Grasshopper.Kernel.Data;
using Grasshopper.Kernel.Types;
#endregion

public class Script_Instance : GH_ScriptInstance
{
    #region Notes
    /* 
      Members:
        RhinoDoc RhinoDocument
        GH_Document GrasshopperDocument
        IGH_Component Component
        int Iteration

      Methods (Virtual & overridable):
        Print(string text)
        Print(string format, params object[] args)
        Reflect(object obj)
        Reflect(object obj, string method_name)
    */
    #endregion

    private void RunScript(int cnt, ref object a)
    {
        List<double> lst=new List<double>();
        for (int i=0; i<cnt; i++) lst.Add(1);
        a = lst;
    }
}
# ---------- end list_value_1 ----------
metaball_t_custom = MetaBallTCustom(Points=populate_2d, Charge=list_value_1, Plane=plane, Threshold=multiplication_2)

# ---- group: Odstranit část nad pevninou
extrusion = Extrusion(<extrusion referenced from the Rhino model>)
split_with_brep = SplitWithBrep(Curve=metaball_t_custom, Brep=extrusion)  # -> reparameterize(flatten(Curve)), Points
list_item_2 = ListItem(List=split_with_brep.Curve, Index="1", Wrap=True)

# ---- group: Normalizovat křivku
start_curve_pt_top = CSharpScript(curve=list_item_2)  # -> out, ecurve; inputs curve: Curve
# ---------- start_curve_pt_top: C# ----------
#region Usings
using System;
using System.Linq;
using System.Collections;
using System.Collections.Generic;
using System.Drawing;

using Rhino;
using Rhino.Geometry;

using Grasshopper;
using Grasshopper.Kernel;
using Grasshopper.Kernel.Data;
using Grasshopper.Kernel.Types;
#endregion

public class Script_Instance : GH_ScriptInstance {
    private void RunScript(Curve curve, ref object ecurve){
        Point3d PtEnd=curve.PointAtEnd;
        Point3d PtStart=curve.PointAtStart;

        if (PtStart.Y<PtEnd.Y) curve.Reverse();
        ecurve = curve;
    }
}
# ---------- end start_curve_pt_top ----------
reparameterize_curve = ReparameterizeCurve(Curve=start_curve_pt_top.ecurve)  # -> Reparameterized, Original

# ---- group: Nastavení schodiště
tlouska_prkna_paluby = Slider(150, range=0..1000)
height_step = Slider(115, range=0..400)
tickness = Slider(46, range=0..50)
depth_step = Slider(359, range=0..500)
steps = Slider(6, range=0..10)

# ---- group: hmota platformy / spojit volné konce
blend_curve = BlendCurve(CurveA=list_item_2, CurveB=list_item_2, BulgeA=1, BulgeB=1, Continuity=Slider(2, range=0..4))

# ---- group: hmota platformy / vytvoření hmoty / Výška hmoty platformy
number_slider_2 = Slider(211, range=1..1000)

# ---- group: Materiál / Barva materiálu
colour_swatch = ColourSwatch(SwatchColor=RGBA(186, 122, 19, 101))

# ---- group: Plovák / posun od křivky XY / Posun od platformy
distance_to_molo = Slider(3108, range=0..4000)

# ---- group: Materiál
wood_material = Material(colour_swatch)

# ---- group: hmota platformy / vytvoření hmoty
merge = Merge(Data1=list_item_2, Data2=blend_curve)
unit_z = UnitZ(Factor=1)
boundary_surfaces = BoundarySurfaces(Edges=merge)
multiplication_3 = Multiplication(A=unit_z, B=number_slider_2)
extrude = Extrude(Base=boundary_surfaces, Direction=multiplication_3)
custom_preview = CustomPreview(Geometry=extrude, Material=wood_material)

# ---- group: voronoi části v palubě
voronoi = Voronoi(Points=populate_2d, BruteForceOverride=False)
surface = Surface(boundary_surfaces)

# ---- group: voronoi části v palubě / voronoi v palubě
surface_curve = SurfaceCurve(Surface=surface, Curve=voronoi)  # -> Curves, Points, UVPoints, Normals, Parameters, Tangents

# ---- group: voronoi části v palubě / rozdělit surface podle voronoi
surface_split = SurfaceSplit(Surface=surface, Curves=voronoi)

# ---- group: linie prken / střed ořízlích voronoi
area = Area(Geometry=surface_split)  # -> Area, Centroid

# ---- group: Rozdělit křivku
curve_curve = CurveCurve(CurveA=reparameterize_curve.Reparameterized, CurveB=voronoi)  # -> flatten(Points), flatten(ParamsA), ParamsB
shatter = Shatter(Curve=reparameterize_curve.Reparameterized, Parameters=curve_curve.ParamsA)

# ---- group: rozdělení křivky / vyčistit při špatných vytvoření
clean_tree = CleanTree(RemoveNulls=True, RemoveInvalid=True, RemoveEmpty="True", Tree=shatter)

# ---- group: rozdělení křivky / seznam se sudými hodnotami
list_length_2 = ListLength(List=clean_tree)
division = Division(A=list_length_2, B="2")
series = Series(Start=0, Step="2", Count=division)

# ---- group: rozdělení křivky
list_item_3 = ListItem(List=clean_tree, Index=series, Wrap=True)

# ---- group: Filtrovat krátké křivky
ignore_small_curves = CSharpScript(Curves=list_item_3, MinLen=Slider(2516, range=0..4000))  # -> a; inputs Curves: list of Curve, MinLen: Double
# ---------- ignore_small_curves: C# ----------
// Grasshopper Script Instance
#region Usings
using System;
using System.Linq;
using System.Collections;
using System.Collections.Generic;
using System.Drawing;

using Rhino;
using Rhino.Geometry;

using Grasshopper;
using Grasshopper.Kernel;
using Grasshopper.Kernel.Data;
using Grasshopper.Kernel.Types;
#endregion

public class Script_Instance : GH_ScriptInstance
{
    #region Notes
    /* 
      Members:
        RhinoDoc RhinoDocument
        GH_Document GrasshopperDocument
        IGH_Component Component
        int Iteration

      Methods (Virtual & overridable):
        Print(string text)
        Print(string format, params object[] args)
        Reflect(object obj)
        Reflect(object obj, string method_name)
    */
    #endregion

    private void RunScript(List<Curve> Curves, double MinLen, ref object a)
    {
        List<Curve> curves=new List<Curve>();
        
        foreach (Curve c in Curves) {
            double len=c.GetLength();
            if (len>MinLen)curves.Add(c);
        }
        a = curves;
    }
}
# ---------- end ignore_small_curves ----------

# ---- group: Plovák / create points
center_of_params = CSharpScript(Params=curve_curve.ParamsA)  # -> Nums; inputs Params: list of Double
# ---------- center_of_params: C# ----------
// Grasshopper Script Instance
#region Usings
using System;
using System.Linq;
using System.Collections;
using System.Collections.Generic;
using System.Drawing;

using Rhino;
using Rhino.Geometry;

using Grasshopper;
using Grasshopper.Kernel;
using Grasshopper.Kernel.Data;
using Grasshopper.Kernel.Types;
#endregion

public class Script_Instance : GH_ScriptInstance
{
    private void RunScript(List<double> Params, ref object Nums)
    {        
        // Setřídit od nejmenšího po největší
        Params.Sort();

        List<double> p=new List<double>();
        // paramtery mezi parametry (každé druhé)
        for (int i=1; i<Params.Count-3; i+=2*2) p.Add((Params[i]+Params[i+1])/2);
        Nums = p;
    }
}
# ---------- end center_of_params ----------
evaluate_curve = EvaluateCurve(Curve=reparameterize_curve.Reparameterized, Parameter=center_of_params)  # -> Point, Tangent, Angle

# ---- group: offset curves
series_2 = Series(Start=0, Step=depth_step, Count=steps)
cross_reference = CrossReference(ListListA=ignore_small_curves, ListListB=series_2, CrossMode=1)  # -> ListListA, ListListB
xy_plane_2 = XYPlane(Origin=Point(0, 0, 0))
offset_curve = OffsetCurve(Curve=cross_reference.ListListA, Distance=cross_reference.ListListB, Plane=xy_plane_2, Corners="3")  # -> flatten(Curve)
check_same_len = CSharpScript(x=cross_reference.ListListA, y=offset_curve)  # inputs x: list, y: list
# ---------- check_same_len: C# ----------
// Grasshopper Script Instance
#region Usings
using System;
using System.Linq;
using System.Collections;
using System.Collections.Generic;
using System.Drawing;

using Rhino;
using Rhino.Geometry;

using Grasshopper;
using Grasshopper.Kernel;
using Grasshopper.Kernel.Data;
using Grasshopper.Kernel.Types;
#endregion

public class Script_Instance : GH_ScriptInstance
{
    #region Notes
    /* 
      Members:
        RhinoDoc RhinoDocument
        GH_Document GrasshopperDocument
        IGH_Component Component
        int Iteration

      Methods (Virtual & overridable):
        Print(string text)
        Print(string format, params object[] args)
        Reflect(object obj)
        Reflect(object obj, string method_name)
    */
    #endregion

    private void RunScript(List<object> x, List<object> y)
    {
        if (x.Count!=y.Count) throw new Exception();
    }
}
# ---------- end check_same_len ----------

# ---- group: Plovák / posun od křivky XY
rotate = Rotate(Geometry=evaluate_curve.Tangent, Angle=-1.570796327, Plane=PlaneXY(0, 0, 0))  # -> Geometry, Transform
multiplication_4 = Multiplication(A=rotate.Geometry, B=distance_to_molo)
move_2 = Move(Geometry=evaluate_curve.Point, Motion=multiplication_4)  # -> Geometry, Transform

# ---- group: Plovák / posun od křivky Z / Výška od platformy (jak moc ve vodě)
number_slider_3 = Slider(382, range=0..1000)

# ---- group: křivku převést na polyline
control_points_2 = ControlPoints(Curve=offset_curve)  # -> Points, Weights, Knots
polyline = PolyLine(Vertices=control_points_2.Points, Closed=False)  # -> flatten(Polyline)
list_length_3 = ListLength(List=ignore_small_curves)
list_divide = CSharpScript(list=polyline, d=list_length_3)  # -> a; inputs list: list, d: Int32
# ---------- list_divide: C# ----------
// Grasshopper Script Instance
#region Usings
using System;
using System.Linq;
using System.Collections;
using System.Collections.Generic;
using System.Drawing;

using Rhino;
using Rhino.Geometry;

using Grasshopper;
using Grasshopper.Kernel;
using Grasshopper.Kernel.Data;
using Grasshopper.Kernel.Types;
#endregion

public class Script_Instance : GH_ScriptInstance
{
    #region Notes
    /* 
      Members:
        RhinoDoc RhinoDocument
        GH_Document GrasshopperDocument
        IGH_Component Component
        int Iteration

      Methods (Virtual & overridable):
        Print(string text)
        Print(string format, params object[] args)
        Reflect(object obj)
        Reflect(object obj, string method_name)
    */
    #endregion

    private void RunScript(List<object> list, int d, ref object a)
    {
        DataTree<object> tree=new DataTree<object>();

        for (int p=0; p<list.Count/d; p++) {

            List<object> branch=new List<object>();
            for (int i=0; i<list.Count && i<d; i++) {
                branch.Add(list[p*d+i]);
            }
            
            GH_Path path1 = new GH_Path(p);
            tree.AddRange(branch, path1);
        }
        
        a = tree;
    }
}
# ---------- end list_divide ----------
flip_matrix = FlipMatrix(Data=list_divide)

# ---- group: Plovák / posun od křivky Z
vector_xyz = VectorXYZ(XComponent=0, YComponent=0, ZComponent=number_slider_3)  # -> Vector, Length
multiplication_5 = Multiplication(A=vector_xyz.Vector, B=-1)
move_3 = Move(Geometry=move_2.Geometry, Motion=multiplication_5)  # -> Geometry, Transform
xy_plane_3 = XYPlane(Origin=move_3.Geometry)

# ---- group: Plovák / Rozměry plováku
A = Slider(1158, range=0..3000)
height = Slider(199, range=1..1000)
B = Slider(702, range=0..1000)

# ---- group: stairs mass / Stupnice
stairs_build = CSharpScript(curve=flip_matrix, stepHeight=height_step, stepWidth=depth_step, numSteps=steps)  # -> out, flatten(a), b; inputs curve: list of Polyline, stepHeight: Double, stepWidth: Double, numSteps: Int32
# ---------- stairs_build: C# ----------
// Grasshopper Script Instance
#region Usings
using System;
using System.Linq;
using System.Collections;
using System.Collections.Generic;
using System.Drawing;

using Rhino;
using Rhino.Geometry;

using Grasshopper;
using Grasshopper.Kernel;
using Grasshopper.Kernel.Data;
using Grasshopper.Kernel.Types;
#endregion

public class Script_Instance : GH_ScriptInstance {
    private void RunScript(
	List<Polyline> curve,
	double stepHeight,
	double stepWidth,
	int numSteps,
	ref object a,
	ref object b) {

        // Stupnice
        List<Polyline> polylines=new List<Polyline>();
        for (int i=0; i+1<numSteps; i++) {
            Polyline curOffset0=curve[i+1].Duplicate();
            Polyline curOffset1=curve[i];

            // Uzavřená polyline
            List<Point3d> ptrs=curOffset1.ToList();
            ptrs.Reverse();
            curOffset0.AddRange(ptrs);
            curOffset0.Add(curOffset0.PointAt(0));

            // Na stejné výšce
            Transform translation0 = Transform.Translation(0, 0, -stepHeight*i);
            curOffset0.Transform(translation0);

            polylines.Add(curOffset0);
        }
        a=polylines;

        // Podstupnice
        List<Polyline> polylinesH=new List<Polyline>();
        for (int i=0; i<numSteps; i++) {
            Polyline curOffset0=curve[i];         

            Polyline curOffset1=curOffset0.Duplicate();          
            Transform translation1 = Transform.Translation(0, 0, -stepHeight*i);
            curOffset1.Transform(translation1);

            polylinesH.Add(curOffset1);
        }
        b=polylinesH;
    }
}
# ---------- end stairs_build ----------
vector_xyz_2 = VectorXYZ(XComponent=0, YComponent=0, ZComponent=tickness)  # -> Vector, Length
boundary_surfaces_2 = BoundarySurfaces(Edges=graft(stairs_build.a))
extrude_2 = Extrude(Base=boundary_surfaces_2, Direction=vector_xyz_2.Vector)
custom_preview_2 = CustomPreview(Geometry=flatten(extrude_2), Material=wood_material)

# ---- group: stairs mass / Podstupnice
vector_xyz_3 = VectorXYZ(XComponent=0, YComponent=0, ZComponent=height_step)  # -> Vector, Length
extrude_3 = Extrude(Base=stairs_build.b, Direction=vector_xyz_3.Vector)
custom_preview_3 = CustomPreview(Geometry=flatten(extrude_3), Material=wood_material)

# ---- group: Plovák / Upravit natočení plováku
vector_to_angle = CSharpScript(vec=evaluate_curve.Tangent)  # -> a; inputs vec: Vector3d
# ---------- vector_to_angle: C# ----------
// Grasshopper Script Instance
#region Usings
using System;
using System.Linq;
using System.Collections;
using System.Collections.Generic;
using System.Drawing;

using Rhino;
using Rhino.Geometry;

using Grasshopper;
using Grasshopper.Kernel;
using Grasshopper.Kernel.Data;
using Grasshopper.Kernel.Types;
#endregion

public class Script_Instance : GH_ScriptInstance
{
    #region Notes
    /* 
      Members:
        RhinoDoc RhinoDocument
        GH_Document GrasshopperDocument
        IGH_Component Component
        int Iteration

      Methods (Virtual & overridable):
        Print(string text)
        Print(string format, params object[] args)
        Reflect(object obj)
        Reflect(object obj, string method_name)
    */
    #endregion

    private void RunScript(Vector3d vec, ref object a)
    {
        vec.Unitize();
        a=Math.Atan2(vec.Y, vec.X);
    }
}
# ---------- end vector_to_angle ----------
ellipse = Ellipse(Plane=xy_plane_3, Radius1=B, Radius2=A)  # -> Ellipse, Focus1, Focus2
rotate_2 = Rotate(Geometry=ellipse.Ellipse, Angle=vector_to_angle, Plane=xy_plane_3)  # -> Geometry, Transform

# ---- group: Plovák
unit_z_2 = UnitZ(Factor=1)
boundary_surfaces_3 = BoundarySurfaces(Edges=rotate_2.Geometry)
multiplication_6 = Multiplication(A=unit_z_2, B=height)
extrude_4 = Extrude(Base=boundary_surfaces_3, Direction=multiplication_6)
custom_preview_4 = CustomPreview(Geometry=extrude_4, Material=wood_material)

# ---- group: linie prken / náhodné úhlové vektory
construct_domain_2 = ConstructDomain(DomainStart=0, DomainEnd="pi")

# ---- group: linie prken
list_length_4 = ListLength(List=voronoi)

# ---- group: linie prken / náhodné úhlové vektory (continued)
random = Random(Range=construct_domain_2, Number=list_length_4, Seed=2)
angle_to_vector = CSharpScript(Angle=random)  # -> Vector
# ---------- angle_to_vector: C# ----------
// Grasshopper Script Instance
#region Usings
using System;
using System.Linq;
using System.Collections;
using System.Collections.Generic;
using System.Drawing;

using Rhino;
using Rhino.Geometry;

using Grasshopper;
using Grasshopper.Kernel;
using Grasshopper.Kernel.Data;
using Grasshopper.Kernel.Types;
#endregion

public class Script_Instance : GH_ScriptInstance {
    private void RunScript(object Angle, ref object Vector) {
        Vector=new Vector3d(Math.Cos((double)Angle), Math.Sin((double)Angle), 0);
    }
}
# ---------- end angle_to_vector ----------

# ---- group: linie prken / kolmý vektor
addition = Addition(A=random, B="pi/2")
angle_to_vector_2 = CSharpScript(Angle=addition)  # -> Vector; same code as angle_to_vector

# ---- group: linie prken / range
construct_domain_3 = ConstructDomain(DomainStart="-1", DomainEnd="1")
pocet_prkem = Panel("30")
range = Range(Domain=construct_domain_3, Steps=pocet_prkem)
multiplication_7 = Multiplication(A=pocet_prkem, B=tlouska_prkna_paluby)
multiplication_8 = Multiplication(A=range, B=multiplication_7)
multiplication_9 = Multiplication(A=multiplication_8, B=graft(angle_to_vector_2))

# ---- group: linie prken / series of lines / start and end of line
multiplication_10 = Multiplication(A=angle_to_vector, B="10000")
multiplication_11 = Multiplication(A="10000", B="-2")
move_4 = Move(Geometry=area.Centroid, Motion=multiplication_10)  # -> Geometry, Transform

# ---- group: linie prken / series of lines
line_sdl = LineSDL(Start=move_4.Geometry, Direction=multiplication_10, Length=multiplication_11)  # -> graft(Line)

# ---- group: linie prken (continued)
move_5 = Move(Geometry=line_sdl, Motion=multiplication_9)  # -> Geometry, Transform
surface_curve_2 = SurfaceCurve(Surface=graft(surface_split), Curve=move_5.Geometry)  # -> Curves, Points, UVPoints, Normals, Parameters, Tangents

# ---- group: Linie paluby - zobrazit
merge_2 = Merge(Data1=surface_curve.Curves, Data2=surface_curve_2.Curves)

# ---- group: Linie paluby - zobrazit / posun o výšku paluby
vector = Vector(multiplication_3)
move_6 = Move(Geometry=merge_2, Motion=vector)  # -> Geometry, Transform

# ---- group: Linie paluby - zobrazit (continued)
custom_preview_5 = CustomPreview(Geometry=flatten(move_6.Geometry), Material=ColourSwatch(SwatchColor=RGB(186, 122, 19)))
